# Grasshopper definition ConnectedRandomEqualCubeContours.gh (Grasshopper 0.9.76)
# plug-ins: Python Interpreter

number_slider = Slider(101.09, range=0..1000)
digit_scroller = DigitScroller(Scroller_Digits=12, Scroller_Prefix="A", Scroller_Radix=11, Scroller_Value=238)
digit_scroller_2 = DigitScroller(Scroller_Digits=12, Scroller_Prefix="B", Scroller_Radix=7, Scroller_Value=0.6536)
box = CenterBox(Base=PlaneXY(0, 0, 0), X=number_slider, Y=number_slider, Z=number_slider)
multiplication = Multiplication(A=digit_scroller, B=Slider(511, range=0..1000))
multiplication_2 = Multiplication(A=number_slider, B=digit_scroller_2)
pop3d = Populate3D(Region=box, Count=Slider(10, range=0..1000), Seed=multiplication)
box_2 = CenterBox(Base=pop3d, X=multiplication_2, Y=multiplication_2, Z=multiplication_2)

number_slider_2 = Slider(9145, range=9000..10000)
brep = Brep(box_2)
lng = ListLength(List=brep)
random = Random(Range=Domain(0, 1), Number=lng, Seed=number_slider_2)
volume = Volume(Geometry=brep)  # -> Volume, Centroid
pi = Pi(Factor=2)
multiplication_3 = Multiplication(A=number_slider_2, B=Slider(9090, range=9000..10000))
remap = RemapNumbers(Value=random, Source=Domain(0, 1), Target=pi)  # -> Mapped, Clipped
pop3d_2 = Populate3D(Region={Plane=PlaneXY(0, 0, 0), X=Domain(0, 10), Y=Domain(0, 10), Z=Domain(0, 2)}, Count=lng, Seed=multiplication_3)
rot3d = Rotate3D(Geometry=brep, Angle=remap.Mapped, Center=volume.Centroid, Axis=pop3d_2)  # -> Geometry, Transform
brep_2 = Brep(rot3d.Geometry)

sunion = SolidUnion(Breps=brep_2)
volume_2 = Volume(Geometry=sunion)  # -> Volume, Centroid
sort = SortList(Keys=volume_2.Volume, ValuesA=sunion)  # -> Keys, ValuesA
rev = ReverseList(List=sort.ValuesA)
item = ListItem(List=rev, Index=0, Wrap=True)

brep_3 = Brep(item)
bbox = BoundingBox(Content=brep_3, Plane=PlaneXY(0, 0, 0), UnionBox=True)  # -> Box, Box_2
boxprop = BoxProperties(Box=bbox.Box)  # -> Center, Diagonal, Area, Volume, Degeneracy
debox = DeconstructBox(Box=bbox.Box)  # -> Plane, X, Y, Z
debrep = DeconstructBrep(Brep=bbox.Box)  # -> Faces, Edges, Vertices
item_2 = ListItem(List=debrep.Faces, Index=Slider(4, range=0..10), Wrap=True)
pt = ConstructPoint(XCoordinate=0, YCoordinate=0, ZCoordinate=0)
evalsrf = EvaluateSurface(Surface=item_2, Point=pt)  # -> Point, Normal, Frame
range = Range(Domain=debox.Z, Steps=Slider(110, range=0..10000))
xy = XYPlane(Origin=Point(0, 0, 0))
contour = ContourEx(Shape=brep_3, Plane=debox.Plane, Offsets=range)
crv = Curve(contour)

digit_scroller_3 = DigitScroller(Scroller_Digits=12, Scroller_Prefix="Y coordinate", Scroller_Radix=8, Scroller_Value=0.5053)

crv_2 = Curve(crv)
pt_2 = ConstructPoint(XCoordinate=Slider(0.3507, range=0..1), YCoordinate=digit_scroller_3, ZCoordinate=0)
sph = Sphere(Base=PlaneXY(0, 0, 0), Radius=1)
evalsrf_2 = EvaluateSurface(Surface=reparameterize(sph), Point=pt_2)  # -> Point, Normal, Frame
project = Project(Geometry=crv_2, Plane=evalsrf_2.Frame)  # -> flatten(Geometry), Transform
crv_3 = Curve(project.Geometry)

rec = Rectangle({Plane=PlaneXY(0.5, 0.5, 0), Size=Domain2(u=0..17, v=0..23)})
neg = Negative(Value=Slider(0.617, range=0..10))
offset = Offset(Curve=rec, Distance=neg, Plane=PlaneXY(0, 0, 0), Corners=1)

rec_2 = Rectangle(offset)
pcen = PolygonCenter(Polyline=rec_2)  # -> CenterV, CenterE, CenterA
xy_2 = XYPlane(Origin=pcen.CenterV)

crv_4 = Curve(crv_3)
pln = Plane(xy_2)
orient = Orient(Geometry=crv_4, Source=evalsrf_2.Frame, Target=pln)  # -> Geometry, Transform
crv_5 = Curve(orient.Geometry)
rec_3 = Rectangle(rec_2)
python = PythonScript(geometry=crv_5, bounding_frame=rec_3)  # -> out, reoriented_geometry; inputs geometry: list of GeometryBase, bounding_frame: Curve
# ---------- python: Python ----------
import Rhino

full_bbox = None

actual_geoms = [geom for geom in geometry if geom]
for geom in actual_geoms:
    if geom:
        bbox = geom.GetBoundingBox(True)
        if not full_bbox:
            full_bbox = bbox
        else:
            full_bbox.Union(bbox)

left = full_bbox.Min.X
right = full_bbox.Max.X
top = full_bbox.Max.Y
bottom = full_bbox.Min.Y

width = right - left
height = top - bottom

frame = bounding_frame.GetBoundingBox(True)
frame_width = frame.Max.X - frame.Min.X
frame_height = frame.Max.Y - frame.Min.Y

scale_to_fit_width = frame_width / width
scale_to_fit_height = frame_height / height

scale = Rhino.Geometry.Transform.Scale(
    frame.Center,
    min([scale_to_fit_width, scale_to_fit_height]))
move_vector = frame.Center - full_bbox.Center

for geom in actual_geoms:
    geom.Translate(move_vector)
    geom.Transform(scale)

reoriented_geometry = actual_geoms
# ---------- end python ----------
crv_6 = Curve(python.reoriented_geometry)

bigkatamarijumblediagonaltopo = Curve([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])
fouroverlaplightandshade = Curve([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])
satinglasstwenty = Curve([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])
luminanttencube = Curve([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])
luminanttencube_2 = Curve(crv_6)
preview = CustomPreview(Geometry=luminanttencube_2, Shader=ColourSwatch(SwatchColor=RGB(0, 0, 0)))
